% Simulink data dictionary example_collectorUnglazedSLDD.sldd

THB = Simulink.Bus()
  ID: double
  Temperature: double
  MassFlow: double
  Pressure: double
  FluidType: double
  FluidMix: double
  FluidMix2: double
  FluidMix3: double
  DiameterLastPiece: double
  DPConstant: double
  DPLinear: double
  DPQuadratic: double
  HydraulicInductance: double
  GeodeticHeight: double

WDB = Simulink.Bus()  % weather data bus:
  % timevalue (comment line) format YYYYMMDDHHMM  Y is the year, M the month, D the day, H the hour
  % zenith angle of sun (at time, not averaged)         degree
  % azimuth angle of sun (0°=south, east negative)      degree
  % direct beam solar radiation on a normal surface     W/m^2
  % diffuse solar radiation on a horizontal surface     W/m^2
  % ambient temperature                                 degree Celsius
  % radiation temperature of sky                        degree Celsius
  % relative humidity                                   percent
  % precipitation                                       m/s
  % cloud index (0=no cloud, 1=covered sky)             -
  % station pressure                                    Pa
  % mean wind speed                                     m/s
  % wind direction (north=0° west=270°)                 degree
  % incidence angle on surface (0° = vertical)          degree
  % incidence angle in a vertical plane on the collecor degree  orientation of the plane is parallel to the risers, referred as longitudinal plane in EN 12975
  % incidence angle in a vertical plane on the collecor degree   orientation of the plane is parallel to the headers, referred as transversal plane in EN 12975
  % direct solar radiation on surface                   W/m^2
  % diffuse solar radiation on surface                  W/m^2
  TimeValueComment: double
  Zenith_Angle: double
  Azimuth_Angle: double
  Solar_Radiation_beam_normal: double
  Solar_Radiation_diffuse_horizontal: double
  Temperature_Ambient: double
  Temperature_Sky_Radiation: double
  Relative_Humidity: double
  Precipitation: double
  Cloud_Index: double
  Station_Pressure: double
  Wind_Speed: double
  Wind_Direction: double
  Incidence_Angle_sun: double
  Incidence_Angle_longitudinal: double
  Incidence_Angle_transversal: double
  Solar_Radiation_direct_surface: double
  Solar_Radiation_diffuse_surface: double

collectorfilename = "DefaultCollectorUnglazed.mat"
collectorsurface = 2.5